# Grasshopper definition warmup.gh (Grasshopper 1.0.8)

panel = Panel("Setup your workspace!")
panel_2 = Panel("Fix this flow")
# Preview result in panel
number_slider = Slider(10.98, range=0.2..34)
# Create 5 points with equal spacing of 10 units along the X direction
number_slider_2 = Slider(10, range=0..10)
# Do the same, but this time: 1) use an arbitrary drawn 2D shape in Rhino instead of a point, and 2) change the number of translations from 5 to 100 and the spacing to 0.256
number_slider_3 = Slider(5, range=0..10)
# Create five random numbers between 0.24 and 200.00
number_slider_4 = Slider(0.5, range=0..1)
# Create a series of 100 numbers with an equal interval of 2
# Load a point from Rhino
number_slider_5 = Slider(100, range=0..100)
# The result should be 222
panel_3 = Panel("2")
# Load a point from Rhino and display it using the "dot display" component
# Load two points (a and b) and create a vector from a to b. Preview the vector in the Rhino viewport
number_slider_6 = Slider(1, range=0..3)
number_slider_7 = Slider(5, range=0..10)
addition = Addition(A=number_slider, B=Slider(8, range=1..10))
multiplication = Multiplication(A=panel_3)
pt = ConstructPoint(XCoordinate=0, YCoordinate=0, ZCoordinate=0)
series = Series(Start=0, Step=number_slider_2, Count=number_slider_3)
series_2 = Series(Start=0, Step=Slider(0.256, range=0..10), Count=Slider(100, range=0..100))
crv = Curve(<curve referenced from the Rhino model>)
swatch = ColourSwatch(SwatchColor=RGB(0, 0, 0))
pt_2 = Point()
pt_3 = Point()
dom = ConstructDomain(DomainStart=number_slider_4, DomainEnd=1)
series_3 = Series(Start=0, Step=1, Count=10)
pt_4 = Point()
X = UnitX(Factor=1)
X_2 = UnitX(Factor=1)
pt_a = ConstructPoint(XCoordinate=0, YCoordinate=0, ZCoordinate=0)
pt_b = ConstructPoint(XCoordinate=Slider(7.5, range=0..10), YCoordinate=Slider(4.3, range=0..10), ZCoordinate=0)
panel_4 = Panel(multiplication)
random = Random(Range=Domain(0, 1), Number=1, Seed=2)
move = Move(Geometry=pt, Motion=X)  # -> Geometry, Transform
move_2 = Move(Geometry=crv, Motion=X_2)  # -> Geometry, Transform
panel_5 = Panel(series_3)
move_3 = Move(Motion=Slider(10, range=0..10))  # -> Geometry, Transform
vec2pt = Vector2Pt(PointA=pt_a, PointB=pt_b, Unitize=False)  # -> Vector, Length
panel_6 = Panel(random)
vdis = VectorDisplay(Anchor=pt_a)
dots = DotDisplay(Colour=ColourSwatch(SwatchColor=RGB(0, 0, 0)), Size=Slider(1, range=0..3))
dots_2 = DotDisplay(Colour=ColourSwatch(SwatchColor=RGB(0, 0, 0)), Size=Slider(1, range=0..3))
dots_3 = DotDisplay(Colour=ColourSwatch(SwatchColor=RGB(0, 0, 0)), Size=Slider(1, range=0..3))
