# Grasshopper definition warmup_260511.gh (Grasshopper 1.0.8)

# CHALLENGES
panel = Panel("1. Setup your workspace!")
panel_2 = Panel("9. Fix this flow")
# 2. Preview result in panel
number_slider = Slider(10.98, range=0.2..34)
# 10. Create 5 points with equal spacing of 10 units along the X direction
number_slider_2 = Slider(10, range=0..10)
# 11. Do the same, but this time: 1) use an arbitrary drawn 2D shape in Rhino instead of a point, and 2) change the number of geometric translations from 5 to 100 and the spacing to 0.256
number_slider_3 = Slider(5, range=0..10)
# 4. Create five random numbers between 0.24 and 200.00
number_slider_4 = Slider(0.5, range=0..1)
# 5. Create a series of 100 numbers with an equal interval of 2
# 6. Load a point from Rhino
number_slider_5 = Slider(100, range=0..100)
# 3. The result should be 222
panel_3 = Panel("2")
# 7. Load a point from Rhino and display it using the "dot display" component
# 8. Load two points (a and b) and create a vector from a to b. Preview the vector in the Rhino viewport
number_slider_6 = Slider(1, range=0..3)
number_slider_7 = Slider(5, range=0..10)
addition = Addition(A=number_slider, B=Slider(8, range=1..10))
multiplication = Multiplication(A=panel_3)
pt = ConstructPoint(XCoordinate=0, YCoordinate=0, ZCoordinate=0)
series = Series(Start=0, Step=number_slider_2, Count=number_slider_3)
series_2 = Series(Start=0, Step=Slider(10, range=0..10), Count=Slider(5, range=0..100))
crv = Curve(<curve referenced from the Rhino model>)
swatch = ColourSwatch(SwatchColor=RGB(0, 0, 0))
pt_2 = Point()
pt_3 = Point()
dom = ConstructDomain(DomainStart=number_slider_4, DomainEnd=1)
series_3 = Series(Start=0, Step=1, Count=10)
pt_4 = Point()
X = UnitX(Factor=1)
X_2 = UnitX(Factor=1)
pt_a = ConstructPoint(XCoordinate=0, YCoordinate=0, ZCoordinate=0)
pt_b = ConstructPoint(XCoordinate=Slider(7.5, range=0..10), YCoordinate=Slider(4.3, range=0..10), ZCoordinate=0)
panel_4 = Panel(multiplication)
random = Random(Range=Domain(0, 1), Number=1, Seed=2)
move = Move(Geometry=pt, Motion=X)  # -> Geometry, Transform
move_2 = Move(Geometry=crv, Motion=X_2)  # -> Geometry, Transform
panel_5 = Panel(series_3)
move_3 = Move(Motion=Slider(10, range=0..10))  # -> Geometry, Transform
vec2pt = Vector2Pt(PointA=pt_a, PointB=pt_b, Unitize=False)  # -> Vector, Length
panel_6 = Panel(random)
vdis = VectorDisplay(Anchor=pt_a)
dots = DotDisplay(Colour=ColourSwatch(SwatchColor=RGB(0, 0, 0)), Size=Slider(1, range=0..3))
preview = CustomPreview(Material=ColourSwatch(SwatchColor=RGB(0, 0, 0)))
dots_2 = DotDisplay(Colour=ColourSwatch(SwatchColor=RGB(0, 0, 0)), Size=Slider(1, range=0..3))
# SOLUTIONS
panel_7 = Panel("1. Setup your workspace!")
# Hint: right click on the slider and select "Edit" to change range (min, max) and decimal point accuracy
number_slider_8 = Slider(111, range=0..1000)
# 2. Preview result in panel
# Hint: try dragging the slider value and see the updated output result
number_slider_9 = Slider(10.98, range=0.2..34)
# 10. Create 5 points with equal spacing of 10 units along the X direction
number_slider_10 = Slider(10, range=0..10)
# 11. Do the same, but this time: 1) use an arbitrary drawn 2D shape in Rhino instead of a point, and 2) change the number of geometric translations from 5 to 100 and the spacing to 0.256
number_slider_11 = Slider(5, range=0..10)
# 4. Create five random numbers between 0.24 and 200.00
number_slider_12 = Slider(0.24, range=0..1)
# Hint: a vector is a "distance" along a "direction". For example a vector could be "walk by a meter along North-East". This is a powerful concept that can be used to instantiate geometry in space.
number_slider_13 = Slider(7.5, range=0..10)
# 5. Create a series of 100 numbers with an equal interval of 2
number_slider_14 = Slider(2, range=0..10)
# 6. Load a point from Rhino
number_slider_15 = Slider(100, range=0..100)
# 3. The result should be 222
# Hint: hover over the middle of a component to learn about what it is and what it does
panel_9 = Panel("2")
# 7. Load a point from Rhino and display it using the "dot display" component
# Hint: this is a swatch component--double click on the black bit of the component to explore alternative colors.
# 8. Load two points (a and b) and create a vector from a to b. Preview the vector in the Rhino viewport
number_slider_16 = Slider(1, range=0..3)
# Hint: this is the X-axis vector component that takes "F" or a certain numerical amount as input and outputs a "V" vector of the prescribed amount along the X axis.
number_slider_17 = Slider(10, range=0..10)
# Hint: drag output node of multiplication component to input node of panel component
addition_2 = Addition(A=number_slider_9, B=Slider(8, range=1..10))
multiplication_2 = Multiplication(A=panel_9, B=number_slider_8)
pt_5 = ConstructPoint(XCoordinate=0, YCoordinate=0, ZCoordinate=0)
series_4 = Series(Start=0, Step=number_slider_10, Count=number_slider_11)
series_5 = Series(Start=0, Step=Slider(0.256, range=0..10), Count=Slider(100, range=0..100))
crv_2 = Curve(<curve referenced from the Rhino model>)
pt_6 = Point()
# Hint: hover over a components input names (like R in the Random component) or output names (like I in the Domain component) to see a description of the input. This can help you understand what needs to be connected to what.
dom_2 = ConstructDomain(DomainStart=number_slider_12, DomainEnd=Slider(200, range=0..1000))
# Hint: hover over the middle of a component to learn about what it is and what it does
# Hint: hover over the input nodes to learn more about what they are and the kind of data (numbers, geometry etc.) they need
series_6 = Series(Start=0, Step=number_slider_14, Count=number_slider_15)
# Hint: if your point has been loaded correctly, the point in Rhino should be displayed as a red X
# Hint: this component is a container (meaning it does not do any operation -- unlike a multiplication component -- it just holds data)
# Hint: when the component is orange it means it's empty (no input), if it's light grey it means it's containing data
pt_7 = Point()
pt_8 = Point()
X_3 = UnitX(Factor=series_4)
X_4 = UnitX(Factor=series_5)
# This is a personal preference, but I recommend keeping your workspace clean and consistent:
# 1. Drag your rhino window to the left and keep your grasshopper window to the right (or viceversa).
# 2. Make sure that the windows do not overlap (to avoid hiding toolbars or other important menus).
# Connect R output to the panel input node
panel_10 = Panel(addition_2)
pt_a_2 = ConstructPoint(XCoordinate=0, YCoordinate=0, ZCoordinate=0)
# Hint: when a node is dark grey it means its preview is disabled. Right-click on the node and enable Preview to see the geometry in Rhino. These components output points given X,Y,Z input variables.
pt_b_2 = ConstructPoint(XCoordinate=number_slider_13, YCoordinate=Slider(4.3, range=0..10), ZCoordinate=0)
# 1. Double click on grasshopper canvas to add a new node.
# 2. Type "slider" or "panel" or directly the number you want like "111" (this will automatically create a slider set to the number you typed).
panel_11 = Panel(multiplication_2)
# Hint: if a component is red it means something is wrong. Hover over the little bubble on the top-right of the component to learn more about the error.
X_5 = UnitX(Factor=number_slider_17)
# 1. Right-click on empty canvas.
# 2. Type Dot Display and select the Dot Display component.
# 3. Connect the Pt container to the P input node.
# 4. Connect the color swatch component to the C input node.
# 5. Connect the slider to the S input node.
# Hint: this component has no output nodes because it's only task is to preview and display geometry -- in this case turning points into variably sized and variably colored dots
# Hint: hover over the input nodes to learn more about what they are and the kind of data (numbers, geometry etc.) they need
dots_3 = DotDisplay(Point=pt_6, Colour=ColourSwatch(SwatchColor=RGB(0, 0, 0)), Size=number_slider_16)
random_2 = Random(Range=dom_2, Number=Slider(5, range=0..10), Seed=2)
move_4 = Move(Geometry=pt_5, Motion=X_3)  # -> Geometry, Transform
move_5 = Move(Geometry=crv_2, Motion=X_4)  # -> Geometry, Transform
# 1. Create a slider and set it to 2.
# 2. Connect the slider that is set to 2 to the N input node of the Series component.
# 3. Connect the slider that is set to 100 to the C input node in the Series component.
# 1. Right-click on the Pt container component.
# 2. Select "Set one Point".
# 3. Select a point in Rhino.
panel_12 = Panel(series_6)
move_6 = Move(Geometry=pt_8, Motion=X_5)  # -> Geometry, Transform
vec2pt_2 = Vector2Pt(PointA=pt_a_2, PointB=pt_b_2, Unitize=False)  # -> Vector, Length
# 1. Connect I output node of the Domain component to the R input node of the Random component.
# 2. Create a new slider and set it to 200 and connect it to the B input node of the Domain component.
# 3. Set the first slider to 0.24.
# 4. Connect the slider set to 5 to the N input node of the Random component.
# 5. Verify if results satisfy the challenge.
panel_13 = Panel(random_2)
# Hint: this is another display component. Enable preview by right-clicking on the component and see the vector displayed in Rhino.
vdis_2 = VectorDisplay(Anchor=pt_a_2, Vector=vec2pt_2.Vector)
# Hint: this is another display component. Enable preview by right-clicking on the component and see the geometry displayed in Rhino.
swatch_2 = ColourSwatch(SwatchColor=RGB(0, 0, 0))
# Hint: this is another display component. Enable/disable preview by right-clicking on the component and see the geometry displayed in Rhino.
swatch_3 = ColourSwatch(SwatchColor=RGB(0, 0, 0))
# 1. Review why the node is red (see hint message).
# 2. Create a X vector component (or any other axis-vector component like Y or Z).
# 3. Connect the slider to the F input of the vector component.
# 4. Connect the V output of the vector component to the T input of the Move component.
# 5. Connect the G output of the Move component to the P input of the Dots component.
dots_4 = DotDisplay(Point=move_6.Geometry, Colour=ColourSwatch(SwatchColor=RGB(0, 0, 0)), Size=Slider(1, range=0..3))
# 1. Draw a random polyline in Rhino.
# 2. Right click on the Crv container component.
# 3. Select "Set one Curve".
# 4. In Rhino select the curve you drew.
# 5. Connect the S output node of the Series component to the F input node of the X vector component.
# 6. Connect the G output node of the Move component to the P input node of the Preview component.
preview_2 = CustomPreview(Geometry=move_5.Geometry, Material=swatch_3)
# 1. Connect the S output node of the Series component to the F input node of the X vector component.
# 2. Connect the G output node of the Move component to the P input node of the Dots component.
# 3. Preview the geometry in Rhino by right-clicking on the Dots preview component and enabling preview. You can do the same on the other components if you wish so.
dots_5 = DotDisplay(Point=move_4.Geometry, Colour=swatch_2, Size=Slider(1, range=0..3))
