# Grasshopper definition warmupppp.gh (Grasshopper 1.0.8)
# plug-ins: ShapeDiverForGrasshopper

sddp = ShapeDiverDocumentPayload({AbsoluteTolerance=0, AngleTolerance=0, DistanceDisplayPrecision=0, GltfVersion="Gltf2", GrasshopperVersion="1.0.0008", InputGroups="{}", OutputGroups="{}", RelativeTolerance=0, RhinoVersion="8.14.24345.15002", UnitSystem=0, VersionCreated="1.22.0.0", VersionSaved="1.22.0.0"})
panel = Panel("Fix this flow")
# Create 5 points with equal spacing of 10 units along the X direction
number_slider = Slider(1, range=0..1)
number_slider_2 = Slider(5, range=0..10)
# Preview the result in a panel
number_slider_3 = Slider(10, range=0..10)
# Create five random numbers between 0.24 and 200.00
number_slider_4 = Slider(0.25, range=0..1)
number_slider_5 = Slider(200, range=0..1000)
# The multiplication should return 222
number_slider_6 = Slider(10, range=0..10)
crv = Curve(<curve referenced from the Rhino model>)
# Load a point from Rhino
pt = Point()
# Create 100 random numbers between -100 and 100
random = Random(Range=Domain(0, 1), Number=1, Seed=2)
multiplication = Multiplication(A="2")
eval = EvaluateCurve(Curve=reparameterize(crv), Parameter=number_slider)  # -> Point, Tangent, Angle
pi = Pi(Factor=Slider(0.449, range=0..1))
divide = DivideCurve(Curve=crv, Count=Slider(101, range=0..101), Kinks=False)  # -> Points, Tangents, Parameters
pt_2 = Point()
series = Series(Start=0, Step=1, Count=10)
# Create 5 points with equal spacing of 10 units along the X direction
pt_3 = Point()
addition = Addition(A=number_slider_3, B=number_slider_6)
xy = XYPlane(Origin=divide.Points)
X = UnitX(Factor=1)
neg = Negative(Value=pi)
move = Move(Geometry=pt_2, Motion=Slider(10, range=0..10))  # -> Geometry, Transform
panel_2 = Panel(multiplication)
vrot = Rotate(Vector=divide.Tangents, Axis=xy, Angle=pi)
amp = Amplitude(Vector=vrot, Amplitude=Slider(10.204, range=1..20))
vdis = VectorDisplay(Anchor=divide.Points, Vector=vrot)
pt_4 = Point(move.Geometry)
line = LineSDL(Start=divide.Points, Direction=divide.Tangents, Length=Slider(12, range=1..20))
pt_5 = Point()
dots = DotDisplay(Point=pt_4, Colour=Slider(5, range=0..10), Size=Slider(5, range=0..10))
dots_2 = DotDisplay(Point=pt_5, Colour=RGB(0, 0, 0), Size=Slider(5, range=0..10))
end = EndPoints(Curve=line)  # -> Start, End
curvepoint = PointOnCurve(line, parameter=0.5)
move_2 = Move(Geometry=end.End, Motion=amp)  # -> Geometry, Transform
entwine = Entwine(Branch00=divide.Points, Branch01=curvepoint, Branch02=move_2.Geometry, FlattenInputs=True)
flip = FlipMatrix(Data=entwine)
intcrv = Interpolate(Vertices=flip, Degree=3, Periodic=False, KnotStyle=1)  # -> Curve, Length, Domain
