# Grasshopper definition place-stuff_section-mini.gh (Grasshopper 1.0.8)
# plug-ins: Human

# ----
# Stuff to Place Inputs
pipeline = GeometryPipeline(
    GroupByLayer=False,
    GroupByType=False,
    IncludeHidden=True,
    IncludeLocked=True,
    LayerFilter="OUTLINES",
    NameFilter="*",
    SublayerFiltering=True,
    TypeFilter=4)
crv_objs_to_place = Curve(pipeline)

# ----
# Load Section Curves
pipeline_2 = GeometryPipeline(
    GroupByLayer=False,
    GroupByType=False,
    IncludeHidden=True,
    IncludeLocked=True,
    LayerFilter="section_lines",
    NameFilter="*",
    SublayerFiltering=True,
    TypeFilter=4)
crv_section_crvs = Curve(pipeline_2)

# ----
# Visualize sections
number_slider = Slider(1, range=0.1..2)
crv_section_crvs_2 = Curve(crv_section_crvs)
offs_bottom = OffsBottom(crv_section_crvs=crv_section_crvs_2, offs_d=number_slider)
crv_section_crvs_3 = Curve(graft(crv_section_crvs_2))
crv = Curve(offs_bottom)
end = EndPoints(Curve=[crv, crv_section_crvs_3])  # -> Start, End
pline = PolyLine(Vertices=end.End, Closed=False)
pline_2 = PolyLine(Vertices=end.Start, Closed=False)
# TRANSLATE 2D PEOPLE ONTO CURVE
number_slider_2 = Slider(4, range=0..10)
join = JoinCurves(Curves=[pline_2, pline, crv, crv_section_crvs_3], Preserve=False)
crv_section_crvs_4 = Curve(crv_section_crvs_2)
swatch = ColourSwatch(SwatchColor=RGB(62, 201, 90))
boundary = BoundarySurfaces(Edges=join)
panel = Panel("black")
previewlw = CustomPreviewLineweights(Geometry=crv_section_crvs_4, Shader=swatch, Thickness=number_slider_2, Absolute=False)
preview = CustomPreview(Geometry=boundary, Material=swatch)

# ----
# "every x feet we'd like to place a person"
# higher value means less people
factor = Slider(10, range=0..200)

# ----
# Get objects’ lowest y point
crv_objs_to_place_2 = Curve(crv_objs_to_place)
divlength = DivideLength(Curve=crv_objs_to_place_2, Length="1")  # -> Points, Tangents, Parameters
pdecon = Deconstruct(Point=divlength.Points)  # -> XComponent, YComponent, ZComponent
sort = SortList(Keys=pdecon.YComponent, ValuesA=divlength.Points)  # -> Keys, ValuesA
item = ListItem(List=sort.ValuesA, Index=0, Wrap=True)
pts_geo_to_place_ref_pts = Point(item)

# ----
# RANDOMLY SELECT ONE OF THE PLACED OBJECTS
# Get stuff to place list size
crv_objs_to_place_3 = Curve(crv_objs_to_place)
lng = ListLength(List=crv_objs_to_place_3)
num_of_stuff_to_place = Data(lng)
panel_3 = Panel(num_of_stuff_to_place)

# ----
# Get random pts long section crvs
crv_section_crvs_5 = Curve(crv_section_crvs)
number_slider_3 = Slider(40, range=1..40)
len = Length(Curve=crv_section_crvs_5)
division = Division(A=len, B=factor)
random = Random(Range=Domain(0, 1), Number=division, Seed=number_slider_3)
eval = EvaluateCurve(Curve=reparameterize(graft(crv_section_crvs_5)), Parameter=random)  # -> Point, Tangent, Angle

# ---- group: to show not-rndm spacing
int = Integer(division)
divide = DivideCurve(Curve=crv_section_crvs_5, Count=int, Kinks=False)  # -> Points, Tangents, Parameters

# ----
pt_target_locs = Point(flatten(divide.Points))

# ----
# Get targ pts list size
pt_target_locs_2 = Point(pt_target_locs)
lng_2 = ListLength(List=pt_target_locs_2)
panel_4 = Panel(lng_2)
num_of_target_pts = Data(lng_2)

# ----
# Move objects and display xform
pts_geo_to_place_ref_pts_2 = Point(flatten(pts_geo_to_place_ref_pts))
geo_objs_to_place = Geometry(crv_objs_to_place_2)
pt_target_locs_3 = Point(graft(pt_target_locs_2))
vec2pt = Vector2Pt(PointA=pts_geo_to_place_ref_pts_2, PointB=pt_target_locs_3, Unitize=False)  # -> Vector, Length
points = PointList(Points=flatten(pt_target_locs_3), Size="4")
move = Move(Geometry=geo_objs_to_place, Motion=vec2pt.Vector)  # -> Geometry, Transform
vdis = VectorDisplay(Anchor=pts_geo_to_place_ref_pts_2, Vector=vec2pt.Vector)
placed_geo = Curve(move.Geometry)

# ----
# Get targ pts list size
pt_target_locs_4 = Point(pt_target_locs)
lng_3 = ListLength(List=pt_target_locs_4)
num_of_target_pts_2 = Data(lng_3)
panel_5 = Panel(num_of_target_pts_2)

# ----
# Get rndm ids
num_of_stuff_to_place_2 = Data(num_of_stuff_to_place)
num_of_target_pts_3 = Data(num_of_target_pts_2)
rnd_seed = Data(number_slider_3)
random_2 = Random(Range=num_of_stuff_to_place_2, Number=num_of_target_pts_3, Seed=rnd_seed)
int_2 = Integer(random_2)
rndm_ids_for_stuff_to_place = Data(int_2)

# ----
# Pick one rdm item
rndm_ids_for_stuff_to_place_2 = Data(rndm_ids_for_stuff_to_place)
placed_geo_2 = Curve(placed_geo)
item_2 = ListItem(List=placed_geo_2, Index=graft(rndm_ids_for_stuff_to_place_2), Wrap=True)
placed_geo_3 = Curve(item_2)

# ----
# Visualize
placed_geo_4 = Curve(flatten(placed_geo_3))
lng_4 = ListLength(List=placed_geo_4)
series = Series(Start=0, Step="2", Count=lng_4)
z_height = Data(series)
placed_geo_5 = Curve(placed_geo_4)
Z = UnitZ(Factor=z_height)
move_2 = Move(Geometry=placed_geo_5, Motion=Z)  # -> Geometry, Transform
placed_geo_z = Curve(move_2.Geometry)
Z_2 = UnitZ(Factor="1")
boundary_2 = BoundarySurfaces(Edges=placed_geo_z)
z_height_2 = Data(z_height)
move_3 = Move(Geometry=placed_geo_z, Motion=Z_2)  # -> Geometry, Transform
bnd = Bounds(Numbers=z_height_2)
area = Area(Geometry=move_3.Geometry)  # -> Area, Centroid
dedomain = DeconstructDomain(Domain=bnd)  # -> Start, End
tag = TextTag(Location=area.Centroid, Text=series)
gradient = Gradient(LowerLimit=dedomain.Start, UpperLimit=dedomain.End, Parameter=z_height_2, stops=[0: RGB(255, 255, 255), 1: RGB(0, 0, 0)])
previewlw_2 = CustomPreviewLineweights(Geometry=move_3.Geometry, Shader="white", Thickness=Slider(2, range=1..4), Absolute=False)

srf = Surface(boundary_2)

preview_2 = CustomPreview(Geometry=srf, Material=ColourSwatch(SwatchColor=RGB(255, 0, 0)))

# ==== cluster OffsBottom
crv_section_crvs = ClusterInput()
offs_d = ClusterInput()
crv_section_crvs_2 = Curve(crv_section_crvs)
offs_d_2 = Data(offs_d)
neg = Negative(Value=offs_d_2)
offset = OffsetCurve(Curve=crv_section_crvs_2, Distance=neg, Corners=1)
offset_2 = OffsetCurve(Curve=crv_section_crvs_2, Distance=offs_d_2, Corners=1)
merge = Merge(Data1=offset, Data2=offset_2)
eval = EvaluateCurve(Curve=reparameterize(merge), Parameter="0")  # -> Point, Tangent, Angle
pdecon = Deconstruct(Point=eval.Point)  # -> XComponent, YComponent, ZComponent
sort = SortList(Keys=pdecon.YComponent, ValuesA=merge)  # -> Keys, ValuesA
item = ListItem(List=sort.ValuesA, Index=0, Wrap=True)
i = ClusterOutput(item)
