# Grasshopper definition place-stuff_section.gh (Grasshopper 1.0.8)
# plug-ins: Human

# ----
# Stuff to Place Inputs
pipeline = GeometryPipeline(
    GroupByLayer=False,
    GroupByType=False,
    IncludeHidden=True,
    IncludeLocked=True,
    LayerFilter="OUTLINES",
    NameFilter="*",
    SublayerFiltering=True,
    TypeFilter=4)
crv_objs_to_place = Curve(pipeline)

# ----
# Load Section Curves
pipeline_2 = GeometryPipeline(
    GroupByLayer=False,
    GroupByType=False,
    IncludeHidden=True,
    IncludeLocked=True,
    LayerFilter="section_lines",
    NameFilter="*",
    SublayerFiltering=True,
    TypeFilter=4)
crv_section_crvs = Curve(pipeline_2)

# ----
# Visualize sections
number_slider = Slider(1, range=0.1..1)
crv_section_crvs_2 = Curve(crv_section_crvs)
offs_bottom = OffsBottom(crv_section_crvs=crv_section_crvs_2, offs_d=number_slider)
crv_section_crvs_3 = Curve(graft(crv_section_crvs_2))
crv = Curve(offs_bottom)
end = EndPoints(Curve=[crv, crv_section_crvs_3])  # -> Start, End
pline = PolyLine(Vertices=end.End, Closed=False)
pline_2 = PolyLine(Vertices=end.Start, Closed=False)
join = JoinCurves(Curves=[pline_2, pline, crv, crv_section_crvs_3], Preserve=False)
crv_section_crvs_4 = Curve(crv_section_crvs_2)
swatch = ColourSwatch(SwatchColor=RGB(62, 201, 90))
boundary = BoundarySurfaces(Edges=join)
panel = Panel("black")
previewlw = CustomPreviewLineweights(Geometry=crv_section_crvs_4, Shader=swatch, Thickness=Slider(4, range=0..10), Absolute=False)
preview = CustomPreview(Geometry=boundary, Material=swatch)

# ----
# GET “WALKABLE” PORTIONS
# Discretize section curves into small segments
crv_section_crvs_5 = Curve(crv_section_crvs)
divlength = DivideLength(Curve=crv_section_crvs_5, Length="10")  # -> Points, Tangents, Parameters
shatter = Shatter(Curve=graft(crv_section_crvs_5), Parameters=divlength.Parameters)
eval = EvaluateCurve(Curve=reparameterize(shatter), Parameter=".5")  # -> Point, Tangent, Angle
shattered_crvs = Curve(shatter)
crv_pts = Data(eval.Point)
crv_vectors = Vector(eval.Tangent)

# ----
# Measure each segment’s slope angle
X = UnitX(Factor=1)
crv_vectors_2 = Vector(crv_vectors)
x_vec = Vector(X)
angle = Angle(VectorA=x_vec, VectorB=crv_vectors_2)  # -> Angle, Reflex
slope_angles = Data(angle.Angle)

# ----
# Visualize vectors for slope calc
number_slider_2 = Slider(5, range=1..200)
crv_vectors_3 = Vector(crv_vectors)
amp = Amplitude(Vector=crv_vectors_3, Amplitude=number_slider_2)
amp_2 = Amplitude(Vector=x_vec, Amplitude=number_slider_2)
crv_pts_2 = Data(crv_pts)
crv_pts_3 = Data(crv_pts)
vdisex = VectorDisplayEx(Point=crv_pts_2, Vector=amp, Colour=RGB(0, 0, 0), Width="5")
vdisex_2 = VectorDisplayEx(Point=crv_pts_3, Vector=amp_2, Colour="red", Width="2")

rad = Radians(Degrees=Slider(15, range=0..100))
max_slope_angle = Data(rad)

# ----
# Keep only segments with an acceptable slope angle
slope_angles_2 = Data(slope_angles)
smaller = SmallerThan(FirstNumber=slope_angles_2, SecondNumber=max_slope_angle)  # -> SmallerThan, OrEqualTo
dispatch = Dispatch(List=shattered_crvs, DispatchPattern=smaller.SmallerThan)  # -> ListA, ListB
crv_2 = Curve(dispatch.ListA)
join_2 = JoinCurves(Curves=flatten(crv_2), Preserve=False)
crv_section_crvs_6 = Curve(join_2)

# ----
# Visualize Section By Walkability
slope_angles_3 = Data(flatten(slope_angles))
deg = Degrees(Radians=slope_angles_3)
bnd = Bounds(Numbers=deg)
dedomain = DeconstructDomain(Domain=bnd)  # -> Start, End
gradient = Gradient(
    LowerLimit=dedomain.Start,
    UpperLimit=dedomain.End,
    Parameter=deg,
    stops=[0.0183: RGB(21, 255, 0), 0.309: RGB(255, 196, 0), 0.832: RGB(219, 0, 0)])
shattered_crvs_2 = Curve(flatten(shattered_crvs))
previewlw_2 = CustomPreviewLineweights(Geometry=shattered_crvs_2, Shader=gradient, Thickness=Slider(4, range=0..10), Absolute=False)

# ----
# Visualize Walkable Sections
number_slider_3 = Slider(9, range=0..10)
crv_section_crvs_7 = Curve(crv_section_crvs_6)
previewlw_3 = CustomPreviewLineweights(Geometry=crv_section_crvs_7, Shader=ColourSwatch(SwatchColor=RGB(255, 0, 0)), Thickness=number_slider_3, Absolute=False)

# ----
# TRANSLATE 2D PEOPLE ONTO CURVE
# Get random pts long section crvs
crv_section_crvs_8 = Curve(crv_section_crvs_6)
factor = Slider(5, range=0..200)
number_slider_4 = Slider(40, range=1..40)
len = Length(Curve=crv_section_crvs_8)
division = Division(A=len, B=factor)
random = Random(Range=Domain(0, 1), Number=division, Seed=number_slider_4)
eval_2 = EvaluateCurve(Curve=reparameterize(graft(crv_section_crvs_8)), Parameter=random)  # -> Point, Tangent, Angle
pt_target_locs = Point(flatten(eval_2.Point))

# ----
# Get objects’ lowest y point
crv_objs_to_place_2 = Curve(crv_objs_to_place)
area = Area(Geometry=crv_objs_to_place_2)  # -> Area, Centroid
divlength_2 = DivideLength(Curve=crv_objs_to_place_2, Length="1")  # -> Points, Tangents, Parameters
pdecon = Deconstruct(Point=divlength_2.Points)  # -> XComponent, YComponent, ZComponent
sort = SortList(Keys=pdecon.YComponent, ValuesA=divlength_2.Points)  # -> Keys, ValuesA
item = ListItem(List=sort.ValuesA, Index=0, Wrap=True)
pts_geo_to_place_ref_pts = Point(item)

# ----
# Get targ pts list size
pt_target_locs_2 = Point(pt_target_locs)
lng = ListLength(List=pt_target_locs_2)
panel_3 = Panel(lng)
num_of_target_pts = Data(lng)

# ----
# Move objects and display xform
pts_geo_to_place_ref_pts_2 = Point(flatten(pts_geo_to_place_ref_pts))
pts_geo_to_place_centers = Point(area.Centroid)
pt_target_locs_3 = Point(graft(pt_target_locs_2))
geo_objs_to_place = Geometry(crv_objs_to_place_2)
vec2pt = Vector2Pt(PointA=pts_geo_to_place_ref_pts_2, PointB=pt_target_locs_3, Unitize=False)  # -> Vector, Length
move = Move(Geometry=geo_objs_to_place, Motion=vec2pt.Vector)  # -> Geometry, Transform
vdis = VectorDisplay(Anchor=pts_geo_to_place_ref_pts_2, Vector=vec2pt.Vector)
placed_geo = Curve(move.Geometry)

# ----
# RANDOMLY SELECT ONE OF THE PLACED OBJECTS
# Get stuff to place list size
crv_objs_to_place_3 = Curve(crv_objs_to_place)
lng_2 = ListLength(List=crv_objs_to_place_3)
num_of_stuff_to_place = Data(lng_2)
panel_4 = Panel(num_of_stuff_to_place)

# ----
# Get targ pts list size
pt_target_locs_4 = Point(pt_target_locs)
lng_3 = ListLength(List=pt_target_locs_4)
num_of_target_pts_2 = Data(lng_3)
panel_5 = Panel(num_of_target_pts_2)

# ----
# Get rndm ids
num_of_stuff_to_place_2 = Data(num_of_stuff_to_place)
num_of_target_pts_3 = Data(num_of_target_pts_2)
rnd_seed = Data(number_slider_4)
random_2 = Random(Range=num_of_stuff_to_place_2, Number=num_of_target_pts_3, Seed=rnd_seed)
int = Integer(random_2)
rndm_ids_for_stuff_to_place = Data(int)

# ----
# Pick one rdm item
rndm_ids_for_stuff_to_place_2 = Data(rndm_ids_for_stuff_to_place)
placed_geo_2 = Curve(placed_geo)
item_2 = ListItem(List=placed_geo_2, Index=graft(rndm_ids_for_stuff_to_place_2), Wrap=True)
placed_geo_3 = Curve(item_2)

# ----
# Visualize
placed_geo_4 = Curve(flatten(placed_geo_3))
lng_4 = ListLength(List=placed_geo_4)
series = Series(Start=0, Step="2", Count=lng_4)
z_height = Data(series)
placed_geo_5 = Curve(placed_geo_4)
Z = UnitZ(Factor=z_height)
move_2 = Move(Geometry=placed_geo_5, Motion=Z)  # -> Geometry, Transform
placed_geo_z = Curve(move_2.Geometry)
Z_2 = UnitZ(Factor="1")
move_3 = Move(Geometry=placed_geo_z, Motion=Z_2)  # -> Geometry, Transform
z_height_2 = Data(z_height)
bnd_2 = Bounds(Numbers=z_height_2)
area_2 = Area(Geometry=move_3.Geometry)  # -> Area, Centroid
boundary_2 = BoundarySurfaces(Edges=placed_geo_z)
dedomain_2 = DeconstructDomain(Domain=bnd_2)  # -> Start, End
tag = TextTag(Location=area_2.Centroid, Text=series)
gradient_2 = Gradient(
    LowerLimit=dedomain_2.Start,
    UpperLimit=dedomain_2.End,
    Parameter=z_height_2,
    stops=[0: RGB(255, 255, 255), 1: RGB(0, 0, 0)])
preview_2 = CustomPreview(Geometry=boundary_2, Material=ColourSwatch(SwatchColor=RGB(255, 0, 0)))
previewlw_4 = CustomPreviewLineweights(Geometry=move_3.Geometry, Shader="white", Thickness=Slider(2, range=1..4), Absolute=False)

# ==== cluster OffsBottom
crv_section_crvs = ClusterInput()
offs_d = ClusterInput()
crv_section_crvs_2 = Curve(crv_section_crvs)
offs_d_2 = Data(offs_d)
neg = Negative(Value=offs_d_2)
offset = OffsetCurve(Curve=crv_section_crvs_2, Distance=neg, Corners=1)
offset_2 = OffsetCurve(Curve=crv_section_crvs_2, Distance=offs_d_2, Corners=1)
merge = Merge(Data1=offset, Data2=offset_2)
eval = EvaluateCurve(Curve=reparameterize(merge), Parameter="0")  # -> Point, Tangent, Angle
pdecon = Deconstruct(Point=eval.Point)  # -> XComponent, YComponent, ZComponent
sort = SortList(Keys=pdecon.YComponent, ValuesA=merge)  # -> Keys, ValuesA
item = ListItem(List=sort.ValuesA, Index=0, Wrap=True)
i = ClusterOutput(item)
