# Grasshopper definition vis-analysis.gh (Grasshopper 1.0.8)
# plug-ins: Human

# ---- group: ANALYSIS SAMPLE POINTS
crv_perimeter_wall = Curve(<curve referenced from the Rhino model>)
custom_mesh_settings = SettingsCustom(
    StitchSeams=True,
    SimplePlanes=False,
    Refine=True,
    MinCount=Slider(600, range=8..600),
    MaxCount=400,
    AspectRatio=20,
    MaxDistance=0,
    MaxAngle=20,
    MinEdge=0,
    MaxEdge=0)
# Isovist:
# Volume of Visible Space
# Openness, Visibility
offset = OffsetCurve(Curve=crv_perimeter_wall, Distance="-1", Corners=1)
mesh = MeshBrep(Brep=offset, Settings=custom_mesh_settings)
demesh = DeconstructMesh(Mesh=mesh)  # -> Vertices, Faces, Colours, Normals
pt_sample_pt = Point(demesh.Vertices)

crv_perimeter_wall_2 = Curve(<curve referenced from the Rhino model>)
custom_mesh_settings_2 = SettingsCustom(
    StitchSeams=True,
    SimplePlanes=False,
    Refine=True,
    MinCount=Slider(600, range=8..600),
    MaxCount=400,
    AspectRatio=20,
    MaxDistance=0,
    MaxAngle=20,
    MinEdge=0,
    MaxEdge=0)
# Isovist:
# Volume of Visible Space
# Openness, Visibility
offset_2 = OffsetCurve(Curve=crv_perimeter_wall_2, Distance="-0.25", Corners=1)
mesh_2 = MeshBrep(Brep=offset_2, Settings=custom_mesh_settings_2)
demesh_2 = DeconstructMesh(Mesh=mesh_2)  # -> Vertices, Faces, Colours, Normals
pt_sample_pt_2 = Point(demesh_2.Vertices)

# ---- group: ANALYSIS SOURCE
pt_sample_pt_3 = Point([<point referenced from the Rhino model> x2])

# ---- group: ANALYSIS SAMPLE POINTS
crv_perimeter_wall_3 = Curve(<curve referenced from the Rhino model>)
custom_mesh_settings_3 = SettingsCustom(
    StitchSeams=True,
    SimplePlanes=False,
    Refine=True,
    MinCount=Slider(600, range=8..600),
    MaxCount=400,
    AspectRatio=20,
    MaxDistance=0,
    MaxAngle=20,
    MinEdge=0,
    MaxEdge=0)
# Isovist:
# Volume of Visible Space
# Openness, Visibility
offset_3 = OffsetCurve(Curve=crv_perimeter_wall_3, Distance="-0.25", Corners=1)
mesh_3 = MeshBrep(Brep=offset_3, Settings=custom_mesh_settings_3)
demesh_3 = DeconstructMesh(Mesh=mesh_3)  # -> Vertices, Faces, Colours, Normals
pt_mesh_face_vertices = Point(demesh_3.Vertices)
face = MeshFace(demesh_3.Faces)
pt_sample_pt_4 = Point(demesh_3.Vertices)

# ---- group: ANALYSIS SOURCE
pt_sample_pt_5 = Point(<point referenced from the Rhino model>)

pt_sample_pt_6 = Point(<point referenced from the Rhino model>)

# ---- group: COMPUTE ISOVIST
crv_perimeter_wall_4 = Curve(<curve referenced from the Rhino model>)
# Isovist:
# Volume of Visible Space
# Openness, Visibility
pt_sample_pt_7 = Point(pt_sample_pt_3)
ivist = IsoVist(Plane=pt_sample_pt_7, Count=Slider(120, range=1..150), Radius=Slider(70, range=10..100), Obstacles=crv_perimeter_wall_4)  # -> Points, Distance, Index

crv_perimeter_wall_5 = Curve(<curve referenced from the Rhino model>)
# Isovist:
# Volume of Visible Space
# Openness, Visibility
pt_sample_pt_8 = Point(pt_sample_pt_5)
ivist_2 = IsoVist(Plane=pt_sample_pt_8, Count=Slider(120, range=1..150), Radius=Slider(36, range=10..100), Obstacles=crv_perimeter_wall_5)  # -> Points, Distance, Index

crv_perimeter_wall_6 = Curve(<curve referenced from the Rhino model>)
# Isovist:
# Volume of Visible Space
# Openness, Visibility
pt_sample_pt_9 = Point(pt_sample_pt_6)
ivist_3 = IsoVist(Plane=pt_sample_pt_9, Count=Slider(9, range=1..150), Radius=Slider(30, range=10..100), Obstacles=crv_perimeter_wall_6)  # -> Points, Distance, Index

# ---- group: CREATE GEOMETRY
X = UnitX(Factor=1)
# Heatmaps:
# Converting Numerical Values to Color
pt = Point(<point referenced from the Rhino model>)
line = LineSDL(Start=pt, Direction=X, Length="10")
divide = DivideCurve(Curve=line, Count=Slider(33, range=1..200), Kinks=False)  # -> Points, Tangents, Parameters
pt_2 = Point(divide.Points)

# ---- group: EXTRACT & PROCESS DATA
data_visibility_distance = Data(ivist.Distance)
pt_sample_pt_10 = Point(pt_sample_pt_7)
pt_intx_pts = Point(ivist.Points)
ln = Line(StartPoint=graft(pt_sample_pt_10), EndPoint=pt_intx_pts)
panel = Panel(data_visibility_distance)
data_visibility_distance_2 = Data(data_visibility_distance)
line_visibility_rays = Line(ln)
avr = Average(Input=data_visibility_distance_2)

# ---- group: COMPUTE ISOVIST
crv_perimeter_wall_7 = Curve(crv_perimeter_wall)
pt_sample_pt_11 = Point(pt_sample_pt)
ivist_4 = IsoVist(Plane=pt_sample_pt_11, Count=Slider(120, range=1..150), Radius=Slider(70, range=10..100), Obstacles=crv_perimeter_wall_7)  # -> Points, Distance, Index

pipeline = GeometryPipeline(
    GroupByLayer=False,
    GroupByType=False,
    IncludeHidden=True,
    IncludeLocked=True,
    LayerFilter="walls",
    NameFilter="*",
    SublayerFiltering=True,
    TypeFilter=4)
crv_perimeter_wall_8 = Curve([crv_perimeter_wall_2, pipeline])
pt_sample_pt_12 = Point(pt_sample_pt_2)
ivist_5 = IsoVist(Plane=pt_sample_pt_12, Count=Slider(120, range=1..150), Radius=Slider(70, range=10..100), Obstacles=crv_perimeter_wall_8)  # -> Points, Distance, Index

# ----
pt_mesh_face_vertices_2 = Point(pt_sample_pt_2)

# ---- group: EXTRACT DATA
pt_sample_pt_13 = Point(pt_sample_pt_9)
data_visibility_distance_3 = Data(ivist_3.Distance)
pt_intx_pts_2 = Point(ivist_3.Points)
ln_2 = Line(StartPoint=pt_sample_pt_13, EndPoint=pt_intx_pts_2)
panel_2 = Panel(data_visibility_distance_3)
line_visibility_rays_2 = Line(ln_2)
round = Round(Number=data_visibility_distance_3)  # -> Nearest, Floor, Ceiling
line_visibility_rays_3 = Line(line_visibility_rays_2)
data_visibility_distance_4 = Data(round.Nearest)

pt_sample_pt_14 = Point(pt_sample_pt_8)
data_visibility_distance_5 = Data(ivist_2.Distance)
pt_intx_pts_3 = Point(ivist_2.Points)
ln_3 = Line(StartPoint=pt_sample_pt_14, EndPoint=pt_intx_pts_3)
panel_3 = Panel(data_visibility_distance_5)
line_visibility_rays_4 = Line(ln_3)

# ----
face_2 = MeshFace(demesh_2.Faces)
crv_perimeter_wall_9 = Curve(crv_perimeter_wall_7)

# ---- group: COMPUTE ISOVIST
pipeline_2 = GeometryPipeline(
    GroupByLayer=False,
    GroupByType=False,
    IncludeHidden=True,
    IncludeLocked=True,
    LayerFilter="walls",
    NameFilter="*",
    SublayerFiltering=True,
    TypeFilter=4)
crv_perimeter_wall_10 = Curve([<curve referenced from the Rhino model> x6])
crv_perimeter_wall_11 = Curve([crv_perimeter_wall_3, pipeline_2])
ivist_6 = IsoVist(Plane=pt_sample_pt_4, Count=Slider(120, range=1..150), Radius=Slider(37, range=10..100), Obstacles=crv_perimeter_wall_10)  # -> Points, Distance, Index

# ----
previewlw = CustomPreviewLineweights(Geometry=crv_perimeter_wall_9, Shader="black", Thickness=Slider(5, range=0..10), Absolute=False)

# ---- group: EXTRACT DATA
pdecon = Deconstruct(Point=pt_2)  # -> XComponent, YComponent, ZComponent
data_x_coords = Data(pdecon.XComponent)

# ---- group: EXTRACT & PROCESS DATA
data_visibility_distance_6 = Data(ivist_4.Distance)
pt_sample_pt_15 = Point(pt_sample_pt_11)
data_visibility_distance_7 = Data(data_visibility_distance_6)
panel_4 = Panel(data_visibility_distance_6)
avr_2 = Average(Input=data_visibility_distance_7)

# ----
tag = TextTag(Location=pt_2, Text=data_x_coords)

# ---- group: CONVERT NUM. VALUES TO COLOR
data_visibility_distance_8 = Data(data_visibility_distance_5)
gradient = Gradient(
    LowerLimit=Slider(5, range=0..100),
    UpperLimit=Slider(21, range=0..100),
    Parameter=data_visibility_distance_8,
    stops=[0: RGB(0, 142, 0), 0.499: RGB(254, 251, 0), 1: RGB(255, 38, 0)])
line_visibility_rays_5 = Line(line_visibility_rays_4)
previewlw_2 = CustomPreviewLineweights(Geometry=line_visibility_rays_5, Shader=gradient, Absolute=False)

# ----
crv_perimeter_wall_12 = Curve(crv_perimeter_wall_10)
crv_perimeter_wall_13 = Curve(crv_perimeter_wall_8)

# ---- group: CONVERT NUM. VALUES TO COLOR
data_visibility_distance_9 = Data(data_visibility_distance)
gradient_2 = Gradient(
    LowerLimit=Slider(8, range=0..100),
    UpperLimit=Slider(17, range=0..100),
    Parameter=data_visibility_distance_9,
    stops=[0: RGB(0, 142, 0), 0.5: RGB(254, 251, 0), 1: RGB(255, 38, 0)])
line_visibility_rays_6 = Line(line_visibility_rays)
previewlw_3 = CustomPreviewLineweights(Geometry=line_visibility_rays_6, Shader=gradient_2, Absolute=False)

# ---- group: CONVERT NUM. VALUES TO COLOR (DOTS)
data_visibility_distance_10 = Data(avr)
gradient_3 = Gradient(
    LowerLimit=Slider(4, range=0..100),
    UpperLimit=Slider(12, range=0..100),
    Parameter=data_visibility_distance_10,
    stops=[0: RGB(0, 142, 0), 0.5: RGB(254, 251, 0), 1: RGB(255, 38, 0)])
pt_sample_pt_16 = Point(graft(pt_sample_pt_10))
dots = DotDisplay(Point=pt_sample_pt_16, Colour=gradient_3, Size=Slider(1.2, range=0.1..2))

# ---- group: CONVERT DATA TO COLOR
bnd = Bounds(Numbers=data_x_coords)
data_x_coords_2 = Data(data_x_coords)
dedomain = DeconstructDomain(Domain=bnd)  # -> Start, End
gradient_4 = Gradient(
    LowerLimit=dedomain.Start,
    UpperLimit=dedomain.End,
    Parameter=data_x_coords_2,
    stops=[0: RGB(0, 98, 0), 0.25: RGB(81, 175, 17), 0.5: RGB(159, 198, 146), 0.75: RGB(170, 235, 41), 1: RGB(221, 255, 53)])
pt_3 = Point(pt_2)
dots_2 = DotDisplay(Point=pt_3, Colour=gradient_4, Size=Slider(0.25, range=0..1))

# ----
previewlw_4 = CustomPreviewLineweights(Geometry=crv_perimeter_wall_12, Shader="black", Thickness=Slider(5, range=0..10), Absolute=False)
previewlw_5 = CustomPreviewLineweights(Geometry=crv_perimeter_wall_13, Shader="black", Thickness=Slider(5, range=0..10), Absolute=False)

# ---- group: PLOT DATA
curvepoint = PointOnCurve(line_visibility_rays_3, parameter=0.5)
tag_2 = TextTag(Location=curvepoint, Text=data_visibility_distance_4)

# ---- group: EXTRACT & PROCESS DATA
data_visibility_distance_11 = Data(ivist_6.Distance)
data_visibility_distance_12 = Data(data_visibility_distance_11)
panel_5 = Panel(data_visibility_distance_11)
avr_3 = Average(Input=data_visibility_distance_12)

# ---- group: CONVERT NUM. VALUES TO COLOR (FIELD)
data_visibility_distance_13 = Data(avr_2)
gradient_5 = Gradient(
    LowerLimit=Slider(4, range=0..100),
    UpperLimit=Slider(12, range=0..100),
    Parameter=data_visibility_distance_13,
    stops=[0: RGB(0, 142, 0), 0.5: RGB(254, 251, 0), 1: RGB(255, 38, 0)])
pt_sample_pt_17 = Point(graft(pt_sample_pt_15))
dots_3 = DotDisplay(Point=pt_sample_pt_17, Colour=gradient_5, Size=Slider(0.8, range=0.1..2))

# ---- group: EXTRACT & PROCESS DATA
data_visibility_distance_14 = Data(ivist_5.Distance)
data_visibility_distance_15 = Data(data_visibility_distance_14)
panel_6 = Panel(data_visibility_distance_14)
avr_4 = Average(Input=data_visibility_distance_15)

# ---- group: CONVERT NUM. VALUES TO COLOR (MESH)
data_visibility_distance_16 = Data(avr_3)
gradient_6 = Gradient(
    LowerLimit=Slider(4, range=0..100),
    UpperLimit=Slider(32, range=0..100),
    Parameter=data_visibility_distance_16,
    stops=[0: RGB(0, 142, 0), 0.5: RGB(254, 251, 0), 1: RGB(255, 38, 0)])
pt_mesh_face_vertices_3 = Point(pt_mesh_face_vertices)
face_3 = MeshFace(face)
col = Colour(gradient_6)
conmesh = ConstructMesh(Vertices=pt_mesh_face_vertices_3, Faces=face_3, Colours=flatten(col))
mblur = BlurMesh(Mesh=conmesh, Iterations=Slider(2, range=1..4))

data_visibility_distance_17 = Data(avr_4)
gradient_7 = Gradient(
    LowerLimit=Slider(4, range=0..100),
    UpperLimit=Slider(12, range=0..100),
    Parameter=data_visibility_distance_17,
    stops=[0: RGB(0, 142, 0), 0.5: RGB(254, 251, 0), 1: RGB(255, 38, 0)])
pt_mesh_face_vertices_4 = Point(pt_mesh_face_vertices_2)
face_4 = MeshFace(face_2)
col_2 = Colour(gradient_7)
conmesh_2 = ConstructMesh(Vertices=pt_mesh_face_vertices_4, Faces=face_4, Colours=flatten(col_2))
mblur_2 = BlurMesh(Mesh=conmesh_2, Iterations=Slider(2, range=1..4))

# ---- group: CREATE GEOMETRY
X_2 = UnitX(Factor=1)  # disabled
# Heatmaps
pt_4 = Point(<point referenced from the Rhino model>)  # disabled
panel_7 = Panel("10")  # disabled
line_2 = LineSDL(Start=pt_4, Direction=X_2, Length=panel_7)  # disabled
number_slider = Slider(124, range=1..200)  # disabled
divide_2 = DivideCurve(Curve=line_2, Count=number_slider, Kinks=False)  # -> Points, Tangents, Parameters; disabled
pt_5 = Point(divide_2.Points)  # disabled

# ----
number_slider_2 = Slider(8, range=0..100)  # disabled
pi = Pi(Factor=divide_2.Parameters)  # disabled
sin = Sine(Value=pi)  # disabled
multiplication = Multiplication(A=sin, B=number_slider_2)  # disabled
Y = UnitY(Factor=1)  # disabled
panel_8 = Panel("10")  # disabled
number_slider_3 = Slider(0.14, range=0..1)  # disabled
line_3 = LineSDL(Start=pt_5, Direction=Y, Length=multiplication)  # disabled
divlength = DivideLength(Curve=line_3, Length=number_slider_3)  # -> Points, Tangents, Parameters; disabled
pt_6 = Point(divlength.Points)  # disabled
pt_7 = Point(flatten(pt_6))  # disabled
pdecon_2 = Deconstruct(Point=pt_7)  # -> XComponent, YComponent, ZComponent; disabled
bnd_2 = Bounds(Numbers=pdecon_2.XComponent)  # disabled
dedomain_2 = DeconstructDomain(Domain=bnd_2)  # -> Start, End; disabled
data_x_coords_3 = Data(pdecon_2.XComponent)  # disabled
gradient_8 = Gradient(
    LowerLimit=dedomain_2.Start,
    UpperLimit=dedomain_2.End,
    Parameter=data_x_coords_3,
    stops=[0: RGB(0, 98, 0), 0.25: RGB(81, 175, 17), 0.5: RGB(159, 198, 146), 0.75: RGB(170, 235, 41), 1: RGB(221, 255, 53)])  # disabled
number_slider_4 = Slider(0.25, range=0..1)  # disabled
pt_8 = Point(pt_7)  # disabled
dots_4 = DotDisplay(Point=pt_8, Colour=gradient_8, Size=number_slider_4)  # disabled
