# Grasshopper definition sculpt_and_floor.gh (Grasshopper 1.0.8)
# plug-ins: Human, ShapeDiverForGrasshopper

sddp = ShapeDiverDocumentPayload({AbsoluteTolerance=0, AngleTolerance=0, DistanceDisplayPrecision=0, GltfVersion="Gltf2", GrasshopperVersion="1.0.0008", InputGroups="{}", OutputGroups="{}", RelativeTolerance=0, RhinoVersion="8.14.24345.15002", UnitSystem=0, VersionCreated="1.22.0.0", VersionSaved="1.22.0.0"})
pipeline = GeometryPipeline(
    GroupByLayer=False,
    GroupByType=False,
    IncludeHidden=True,
    IncludeLocked=True,
    LayerFilter="trim",
    NameFilter="*",
    SublayerFiltering=True,
    TypeFilter=1073741848)
brep = Brep(<brep referenced from the Rhino model>)
sdiff = SolidDifference(BrepsA=brep, BrepsB=pipeline)
trim = TrimSolid(Shape=brep, Cutters=pipeline)
capex = CapHolesEx(Brep=sdiff)  # -> Brep, Caps, Solid
brep_2 = Brep(sdiff)
X = UnitX(Factor="100")
move = Move(Geometry=brep_2, Motion=X)  # -> Geometry, Transform
brep_3 = Brep(move.Geometry)
wires = BrepWireframe(Brep=brep_3, Density=-1)
debrep = DeconstructBrep(Brep=brep_3)  # -> Faces, Edges, Vertices
brep_4 = Brep(brep_3)
preview = CustomPreview(Geometry=brep_3, Material=ColourSwatch(SwatchColor=RGB(70, 125, 143)))
contour = Contour(Shape=brep_4, Point=Point(0, 0, 0), Direction=Vector(0, 0, 1), Distance=Slider(2.7, range=0.01..5))
join = JoinCurves(Curves=wires, Preserve=False)
crv = Curve(contour)
Z = UnitZ(Factor=Slider(1.07, range=0.01..5))
crv_2 = Curve(crv)
extr = Extrude(Base=crv, Direction=Z)
previewlw = CustomPreviewLineweights(Geometry=join, Shader=ColourSwatch(SwatchColor=RGB(0, 0, 0)), Thickness=Slider(6, range=0..10), Absolute=False)
divlength = DivideLength(Curve=crv_2, Length="5")  # -> Points, Tangents, Parameters
divide = DivideCurve(Curve=crv_2, Count=Slider(40, range=0..40), Kinks=False)  # -> Points, Tangents, Parameters
capex_2 = CapHolesEx(Brep=extr)  # -> Brep, Caps, Solid
flip = FlipMatrix(Data=divide.Points)
pline = PolyLine(Vertices=flip, Closed=False)
preview_2 = CustomPreview(Geometry=capex_2.Brep, Material=ColourSwatch(SwatchColor=RGB(70, 125, 143)))
