# Grasshopper definition python-warmup.gh (Grasshopper 1.0.8)
# plug-ins: RhinoCodePluginGH, Human

number_slider = Slider(0.25, range=0..1)
spacing = Slider(1, range=0.1..3)
number_slider_2 = Slider(7.761157, range=0..10)
panel = Panel("Variables")
panel_2 = Panel("Conditions")
series = Series(Start=0, Step=1, Count=10)
panel_3 = Panel("A Quick Visual Effect")
panel_4 = Panel("Loops")
panel_5 = Panel("Import Libraries")
panel_6 = Panel("Functions")
series_2 = Series(Start=0, Step=1, Count=10)
py3 = Python3Script(x=Slider(1, range=0..1))  # -> out, a
# ---------- py3: Python ----------
def easeInOutCubic(t):
    t *= 2
    if t < 1:
        return t * t * t / 2
    else:
        t -= 2
        return (t * t * t + 2) / 2

a = easeInOutCubic(x)
# ---------- end py3 ----------
py3_2 = Python3Script(lst_of_values=series_2, new_grid_size=Slider(20, range=1..20))  # -> out, coordinates, point_colors; inputs lst_of_values: list, new_grid_size: Int32
# ---------- py3_2: Python ----------
# exercise 1
for i in range(10):
    print(i)

my_list = []
for i in range(100):
    my_list.append(i)

# exercise 2
# values = ["cement", 2, "wood", "concrete", 0.024]
# for v in values:
#     print(v)

# exercise 3
# for my_val in lst_of_values:
#     if my_val >= 5:
#         print("{} is larger than 5".format(my_val))

# exercise 4
# counter = 0
# while counter < 10:
#     print(counter)
#     counter = counter + 1

# exercise 5
# print("Grid Coordinates (pattern in terminal)")
# grid_size = 5

# for row in range(grid_size):
#     coordinates = ""
#     for col in range(grid_size):
#         coordinates += "({},{}) ".format(row, col)
#     print(coordinates)

# exercise 6
# print("Checkerboard Pattern (pattern in terminal)")
# grid_size = 5

# for row in range(grid_size):
#     pattern = ""
#     for col in range(grid_size):
#         # If the sum of row and column is even, print X, else print O
#         if (row + col) % 2 == 0:
#             pattern += "X "
#         else:
#             pattern += "O "
#     print(pattern)

# print("Grid Coordinates (pattern in terminal)")

# coordinates = []
# for row in range(new_grid_size):
#     for col in range(new_grid_size):
#         new_coordinate = [row, col]
#         coordinates.append(new_coordinate)
# print(coordinates)

# import ghpythonlib.treehelpers as th
# coordinates = th.list_to_tree(coordinates)


# DISPLAY EACH POINT WITH ALTERNATING RED AND BLUE COLORS
# AND INCLUDE A SPACING VARIABLE TO CONTROL THE GRID
# print("Grid Coordinates (pattern in terminal)")

# coordinates = []
# point_colors = []
# col_1 = "red"
# col_2 = "blue"
# for row in range(new_grid_size):
#     for col in range(new_grid_size):
#         new_coordinate = [row, col]
#         if sum(new_coordinate) % 2 == 0:
#             point_colors.append()
#         else:
#             point_colors.append()
#         coordinates.append(new_coordinate)
# print(coordinates)

# import ghpythonlib.treehelpers as th
# coordinates = th.list_to_tree(coordinates)
# ---------- end py3_2 ----------
py3_3 = Python3Script()  # -> out, a
# ---------- py3_3: Python ----------
my_variable = 10.5

my_list_of_variables = [2, 3, 4, 0]

my_other_list_of_materials = ["wood", "cement", "drywall"]

# CREATE A NEW VARIABLE "my_gh_var" CONNECTED TO A SLIDER
# AND PRINT IT TO THE PANEL
# add yout code below


# CREATE A NEW VARIABLE "my_values" CONNECTED TO A RANGE OF VALUES
# AND PRINT IT TO THE PANEL
# add yout code below
# ---------- end py3_3 ----------
py3_4 = Python3Script(freq_x=Slider(7.64, range=0..10), freq_y=Slider(4.585741, range=0..10), n_pts=Slider(162, range=1..200))  # -> out, pts; inputs freq_x: Int32, n_pts: Int32
# ---------- py3_4: Python ----------
import Rhino.Geometry as rg
import math

def lissajous_curve(fr_x=3, fr_y=4, delta=math.pi/2, num_points=1000):
    """
    Generate a Lissajous curve.
    
    Parameters:
    - a: frequency in x direction
    - b: frequency in y direction
    - delta: phase difference (in radians)
    - num_points: number of points to generate
    
    Returns:
    - x, y: coordinates of the curve
    """
    
    step = 2 * math.pi / (num_points - 1) #spacing between pts
    x_coords_ = []
    y_coords_ = []
    pts_ = []
    
    for i in range(num_points):
        t = i * step
        x_value = math.sin(fr_x * t + delta)
        y_value = math.sin(fr_y * t)
        x_coords_.append(x_value)
        y_coords_.append(y_value)
        new_pt = rg.Point3d(x_value, y_value, 0)
        pts_.append(new_pt)
    
    return pts_

pts = lissajous_curve(freq_x, freq_y, math.pi/4, n_pts)
# ---------- end py3_4 ----------
panel_7 = Panel(py3.a)
remap = RemapNumbers(Value=py3.a, Source=Domain(0, 1), Target="0 To 10")  # -> Mapped, Clipped
py3_5 = Python3Script(
    freq_x=Slider(1.79, range=0..10),
    freq_y=Slider(7.510894, range=0..10),
    freq_z=remap.Mapped,
    n_pts=Slider(129, range=1..200))  # -> out, pts; inputs freq_x: Int32, n_pts: Int32
# ---------- py3_5: Python ----------
import Rhino.Geometry as rg
import math

import math
import rhinoscriptsyntax as rs
import Rhino.Geometry as rg

def lissajous_curve_3d(
    fr_x=3, 
    fr_y=4, 
    fr_z=5, 
    delta_xy=math.pi/2, 
    delta_z=math.pi/4, 
    num_points=1000):
    """
    Generate a 3D Lissajous curve.
    
    Parameters:
    - fr_x: frequency in x direction
    - fr_y: frequency in y direction
    - fr_z: frequency in z direction
    - delta_xy: phase difference between x and y (in radians)
    - delta_z: phase difference between x and z (in radians)
    - num_points: number of points to generate
    
    Returns:
    - pts_: list of 3D points forming the curve
    """
    step = 2 * math.pi / (num_points - 1)  # spacing between pts
    x_coords_ = []
    y_coords_ = []
    z_coords_ = []
    pts_ = []
    
    for i in range(num_points):
        t = i * step
        x_value = math.sin(fr_x * t)
        y_value = math.sin(fr_y * t + delta_xy)
        z_value = math.sin(fr_z * t + delta_z)
        
        x_coords_.append(x_value)
        y_coords_.append(y_value)
        z_coords_.append(z_value)
        
        new_pt = rg.Point3d(x_value, y_value, z_value)
        pts_.append(new_pt)
        
    return pts_

pts = lissajous_curve_3d(
    freq_x, 
    freq_y, 
    freq_z, 
    math.pi/4, 
    num_points=n_pts
)
# ---------- end py3_5 ----------
py3_6 = Python3Script()  # -> out, pts
# ---------- py3_6: Python ----------
# exercise 1
import rhinoscriptsyntax as rs
import Rhino.Geometry as rg

spacing = 2
pts = []
for i in range(10):
    new_pt = rg.Point3d(i * spacing, 0, 0)
    pts.append(new_pt)

# CONVERT THE LOGIC ABOVE INTO A FUNCTION 
# THAT TAKES "n_pts" AND "spacing" AS INPUTS
# AND RETURNS "pts" AS OUTPUTS


# exercise 2
import math

trigo = math.cos(math.pi)
print(trigo)
# ---------- end py3_6 ----------
py3_7 = Python3Script()  # -> out, a
# ---------- py3_7: Python ----------
my_value = 1
another_value = 2

a = my_value + another_value
print(a)

def add_machine(v1, v2):
    result = v1 + v2
    return result

res1 = add_machine(1, 2)
print(res1)

res2 = add_machine(2, 4)
print(res2)

res3 = add_machine(0, 0)
print(res3)

# CREATE A FUNCTION THAT RETURNS THE REMAINDER
# OF A DIVISION BETWEEN TWO INPUT VALUES
# ---------- end py3_7 ----------
panel_8 = Panel(series)
# Drop your python node here below
py3_8 = Python3Script()  # -> out, a; unedited script template
py3_9 = Python3Script()  # -> out, a
# ---------- py3_9: Python ----------
# First example
my_boolean = 1
if my_boolean is True:
    print("True! The condition is met!")
else:
    print("False! The condition is not met!")

# Second example
my_other_boolean = False
if my_other_boolean is not True:
    print("True! Your other boolean is not True")

# Third example
my_materials = ["wood", "cement", "metal"]
if "concrete rubble" not in my_materials:
    print("True!")
else:
    print("False!")

# Fourth examples
my_number = 10000

if my_number > 50:
    print("True!")

# USE A SLIDER VARIABLE AND TEST IF THE VALUE IS LARGER THAN 0.5
# PRINT "True" IF THE CONDITION IS TRUE, OTHERWISE PRINT "False"
# add yout code below
# ---------- end py3_9 ----------
panel_9 = Panel(py3_8.out)
panel_10 = Panel(py3_9.out)
pline = PolyLine(Vertices=py3_6.pts, Closed=False)
intcrv = Interpolate(Vertices=py3_4.pts, Degree=3, Periodic=False, KnotStyle=1)  # -> Curve, Length, Domain
intcrv_2 = Interpolate(Vertices=py3_5.pts, Degree=3, Periodic=False, KnotStyle=1)  # -> Curve, Length, Domain
multiplication = Multiplication(A=spacing, B=py3_2.coordinates)
swatch = ColourSwatch(SwatchColor=RGB(195, 227, 191))
pipe = Pipe(Curve=intcrv_2.Curve, Radius=Slider(0.025, range=0..1), Caps=0)
previewlw = CustomPreviewLineweights(Geometry=intcrv.Curve, Shader=ColourSwatch(SwatchColor=RGB(0, 0, 0)), Thickness=Slider(5, range=0..10), Absolute=False)
preview = CustomPreview(Geometry=pipe, Material=swatch)
previewlw_2 = CustomPreviewLineweights(Geometry=intcrv_2.Curve, Shader=swatch, Thickness=Slider(5, range=0..10), Absolute=False)
item = ListItem(List=multiplication, Index=0, Wrap=True)
item_2 = ListItem(List=multiplication, Index=1, Wrap=True)
panel_11 = Panel(py3_2.coordinates)
panel_12 = Panel(py3_2.out)
pt = ConstructPoint(XCoordinate=item, YCoordinate=item_2, ZCoordinate=0)  # -> flatten(Point)
col = Colour(py3_2.point_colors)
dots = DotDisplay(Point=pt, Colour=col, Size=Slider(1, range=0..1))
