# Grasshopper definition walkers_walking.gh (Grasshopper 1.0.8)
# plug-ins: RhinoCodePluginGH, Human

pipeline = GeometryPipeline(
    GroupByLayer=False,
    GroupByType=False,
    IncludeHidden=True,
    IncludeLocked=True,
    LayerFilter="pts",
    NameFilter="*",
    SublayerFiltering=True,
    TypeFilter=1)
pipeline_2 = GeometryPipeline(
    GroupByLayer=False,
    GroupByType=False,
    IncludeHidden=True,
    IncludeLocked=True,
    LayerFilter="pts",
    NameFilter="*",
    SublayerFiltering=True,
    TypeFilter=1)
crv = Curve(<curve referenced from the Rhino model>)
crv_2 = Curve(<curve referenced from the Rhino model>)
crv_3 = Curve(<curve referenced from the Rhino model>)
crv_4 = Curve(<curve referenced from the Rhino model>)
dim = Dimensions(Surface=crv)  # -> UDimension, VDimension
dim_2 = Dimensions(Surface=crv_2)  # -> UDimension, VDimension
dim_3 = Dimensions(Surface=crv_3)  # -> UDimension, VDimension
dim_4 = Dimensions(Surface=crv_4)  # -> UDimension, VDimension
# SIMPLE 3D WALKER
py3 = Python3Script(
    max_x_bound=dim_3.UDimension,
    max_y_bound=dim_3.VDimension,
    step_distance=Slider(1, range=1..10),
    num_of_steps=Slider(265, range=1..500),
    rnd_seed=Slider(56, range=0..100))  # -> out, walker_pts, walker_pts_time; inputs num_of_steps: Int32
# ---------- py3: Python ----------
import Rhino.Geometry as rg
import random as rnd

rnd.seed(rnd_seed)

# num_of_steps = 10
# step_distance = 1

possible_directions = [
    [-1, 0, 0],
    [ 0, 1, 0],
    [ 1, 0, 0],
    [ 0, -1, 0],
    [ 0, 0, 1],
    [ 0, 0, -1],
]

curr_pt = rg.Point3d(0,0,0)
walker_pts = [curr_pt]
walker_pts_time = []

for i in range(num_of_steps):
    print(i)

    # Get random direction
    walker_direction = rnd.choice(possible_directions)
    walker_vector = rg.Vector3d(*walker_direction)
    walker_vector *= step_distance
    print(walker_vector)
    
    new_pt = curr_pt + walker_vector

    if new_pt.X > max_x_bound/2 or new_pt.X < -max_x_bound/2:
        break
    if new_pt.Y > max_y_bound/2 or new_pt.Y < -max_y_bound/2:
        break
    if new_pt.Z < 0:
        break

    walker_pts.append(new_pt)
    walker_pts_time.append(i+1)

    curr_pt = new_pt
# ---------- end py3 ----------
# SIMPLE WALKER
py3_2 = Python3Script(
    max_x_bound=dim_4.UDimension,
    max_y_bound=dim_4.VDimension,
    step_distance=Slider(1, range=1..10),
    num_of_steps=Slider(181, range=1..500),
    rnd_seed=Slider(40, range=0..100))  # -> out, walker_pts; inputs num_of_steps: Int32
# ---------- py3_2: Python ----------
import Rhino.Geometry as rg
import random as rnd

rnd.seed(rnd_seed)

# num_of_steps = 10
# step_distance = 1

possible_directions = [
    [-1, 0, 0],
    [ 0, 1, 0],
    [ 1, 0, 0],
    [ 0, -1, 0],
]

curr_pt = rg.Point3d(0,0,0)
walker_pts = [curr_pt]
walker_pts_time = []

for i in range(num_of_steps):
    print(i)

    # Get random direction
    walker_direction = rnd.choice(possible_directions)
    walker_vector = rg.Vector3d(*walker_direction)
    walker_vector *= step_distance
    print(walker_vector)
    
    new_pt = curr_pt + walker_vector

    if new_pt.X > max_x_bound/2 or new_pt.X < -max_x_bound/2:
        break
    if new_pt.Y > max_y_bound/2 or new_pt.Y < -max_y_bound/2:
        break

    walker_pts.append(new_pt)
    walker_pts_time.append(i+1)

    curr_pt = new_pt
# ---------- end py3_2 ----------
# WALKER FUNCTION
py3_3 = Python3Script(
    origin_pts=pipeline,
    max_x_bound=dim.UDimension,
    max_y_bound=dim.VDimension,
    step_distance=Slider(1, range=1..10),
    num_of_steps=Slider(115, range=1..300),
    rnd_seed=Slider(21, range=0..100))  # -> out, walker_pts, walker_pts_time, all_walker_pts, all_walker_pts_time; inputs origin_pts: list of Point3d, num_of_steps: Int32
# ---------- py3_3: Python ----------
import Rhino.Geometry as rg
import random as rnd



# num_of_steps = 10
# step_distance = 1

def walker(_origin_pt, _num_of_steps, _max_x_bound, _max_y_bound):
    rnd.seed(rnd_seed + _origin_pt.X + _origin_pt.Y)
    possible_directions = [
        [-1, 0, 0],
        [ 0, 1, 0],
        [ 1, 0, 0],
        [ 0, -1, 0],
        [ 0, 0, 1],
        [ 0, 0, -1],
    ]

    curr_pt = _origin_pt
    walker_pts_ = [curr_pt]
    walker_pts_time_ = []

    for i in range(num_of_steps):
        # print(i)

        # Get random direction
        walker_direction = rnd.choice(possible_directions)
        walker_vector = rg.Vector3d(*walker_direction)
        walker_vector *= step_distance
        # print(walker_vector)
        
        new_pt = curr_pt + walker_vector

        if new_pt.X > _max_x_bound/2 or new_pt.X < -_max_x_bound/2:
            break
        if new_pt.Y > _max_y_bound/2 or new_pt.Y < -_max_y_bound/2:
            break
        if new_pt.Z < -20:
            break

        walker_pts_.append(new_pt)
        walker_pts_time_.append(i+1)

        curr_pt = new_pt

    return walker_pts_, walker_pts_time_

all_walker_pts = []
all_walker_pts_time = []
for pt in origin_pts:
    print(pt)
    walker_pts, walker_pts_time = walker(
        pt, 
        num_of_steps,
        max_x_bound,
        max_y_bound
    )
    all_walker_pts.append(walker_pts)
    all_walker_pts_time.append(walker_pts_time)

import ghpythonlib.treehelpers as th

all_walker_pts = th.list_to_tree(all_walker_pts)
all_walker_pts_time = th.list_to_tree(all_walker_pts_time)
# ---------- end py3_3 ----------
# WALKER FUNCTION
# NO SELF-INTX
py3_4 = Python3Script(
    origin_pts=pipeline_2,
    max_x_bound=dim_2.UDimension,
    max_y_bound=dim_2.VDimension,
    step_distance=Slider(1, range=1..10),
    num_of_steps=Slider(265, range=1..265),
    rnd_seed=Slider(53, range=0..100))  # -> out, walker_pts, walker_pts_time, all_walker_pts, all_walker_pts_time; inputs origin_pts: list of Point3d, num_of_steps: Int32
# ---------- py3_4: Python ----------
import Rhino.Geometry as rg
import random as rnd

def walker(_origin_pt, _num_of_steps, _max_x_bound, _max_y_bound, other_walkers_pts=None):
    rnd.seed(rnd_seed + _origin_pt.X + _origin_pt.Y)

    possible_directions = [
        [-1, 0, 0], 
        [ 0, 1, 0],
        [ 1, 0, 0],
        [ 0, -1, 0],
        [ 0, 0, 1],
        [ 0, 0, -1],
    ]
    # rnd.shuffle(possible_directions)

    curr_pt = _origin_pt
    walker_pts_ = [curr_pt]
    walker_pts_time_ = []
    visited_pts = set()  # Track visited points - we'll store them as rounded coordinate tuples

    for i in range(num_of_steps):
        # print(i)

        valid_move_found = False
        
        # Try each direction until we find a valid one
        tested_directions = []
        for i in range(len(possible_directions)):
            walker_direction = rnd.choice(possible_directions)
            if walker_direction in tested_directions:
                continue
            if len(tested_directions) == len(possible_directions):
                break

            walker_vector = rg.Vector3d(*walker_direction)
            walker_vector *= step_distance
            
            # Calculate new point
            new_pt = curr_pt + walker_vector
            
            # Check boundaries
            if new_pt.X > max_x_bound/2 or new_pt.X < -max_x_bound/2:
                continue
            if new_pt.Y > max_y_bound/2 or new_pt.Y < -max_y_bound/2:
                continue
            if new_pt.Z < -20:
                continue
            
            # Check for self-intersection by seeing if we've visited this location before
            # new_pt_key = (round(new_pt.X, 3), round(new_pt.Y, 3), round(new_pt.Z, 3))
            if new_pt in visited_pts:
                continue  # Already visited this point, try another direction
            
            # If we reach here, we found a valid move
            valid_move_found = True
            walker_pts_.append(new_pt)
            walker_pts_time_.append(i+1)
            visited_pts.add(new_pt)
            curr_pt = new_pt
            tested_directions.append(walker_direction)
            break
        
        # If no valid move found in any direction, we're stuck
        if not valid_move_found:
            break

    return walker_pts_, walker_pts_time_

all_walker_pts = []
all_walker_pts_time = []
for pt in origin_pts:
    print(pt)
    walker_pts, walker_pts_time = walker(
        pt, 
        num_of_steps,
        max_x_bound,
        max_y_bound
    )
    all_walker_pts.append(walker_pts)
    all_walker_pts_time.append(walker_pts_time)

import ghpythonlib.treehelpers as th

all_walker_pts = th.list_to_tree(all_walker_pts)
all_walker_pts_time = th.list_to_tree(all_walker_pts_time)
# ---------- end py3_4 ----------
lng = ListLength(List=py3_3.all_walker_pts_time)
lng_2 = ListLength(List=py3_4.all_walker_pts_time)
lng_3 = ListLength(List=flatten(lng))
lng_4 = ListLength(List=flatten(lng_2))
data = Data(py3.walker_pts_time)
series = Series(Start=0, Step=1, Count=lng_3)
series_2 = Series(Start=0, Step=1, Count=lng_4)
points = PointList(Points=py3_4.all_walker_pts, Size=Slider(0.4, range=0.1..5))
bnd = Bounds(Numbers=data)
number_slider = Slider(0.471, range=0..1)
bnd_2 = Bounds(Numbers=series)
bnd_3 = Bounds(Numbers=series_2)
number_slider_2 = Slider(0.471, range=0..1)
number_slider_3 = Slider(0.471, range=0..1)
dedomain = DeconstructDomain(Domain=bnd)  # -> Start, End
dedomain_2 = DeconstructDomain(Domain=bnd_2)  # -> Start, End
dedomain_3 = DeconstructDomain(Domain=bnd_3)  # -> Start, End
gradient = Gradient(
    LowerLimit=dedomain.Start,
    UpperLimit=dedomain.End,
    Parameter=data,
    stops=[0: RGB(0, 98, 0), 0.25: RGB(81, 175, 17), 0.5: RGB(159, 198, 146), 0.75: RGB(170, 235, 41), 1: RGB(221, 255, 53)])
gradient_2 = Gradient(
    LowerLimit=dedomain_2.Start,
    UpperLimit=dedomain_2.End,
    Parameter=series,
    stops=[0.15: RGB(255, 130, 160), 0.85: RGB(0, 219, 91)])
gradient_3 = Gradient(
    LowerLimit=dedomain_3.Start,
    UpperLimit=dedomain_3.End,
    Parameter=series_2,
    stops=[0.15: RGB(255, 130, 160), 0.85: RGB(0, 219, 91)])
dots = DotDisplay(Point=py3.walker_pts, Colour=RGB(0, 0, 0), Size=Slider(0.568, range=0..1))
box = CenterBox(Base=py3.walker_pts, X=number_slider, Y=number_slider, Z=number_slider)
pline = PolyLine(Vertices=py3.walker_pts, Closed=False)
dots_2 = DotDisplay(Point=py3_2.walker_pts, Colour=RGB(0, 0, 0), Size=Slider(0.236, range=0..1))
pline_2 = PolyLine(Vertices=py3_2.walker_pts, Closed=False)
dots_3 = DotDisplay(Point=py3_3.all_walker_pts, Colour=RGB(0, 0, 0), Size=Slider(0.568, range=0..1))
dots_4 = DotDisplay(Point=py3_4.all_walker_pts, Colour=RGB(0, 0, 0), Size=Slider(0.568, range=0..1))
box_2 = CenterBox(Base=py3_3.all_walker_pts, X=number_slider_2, Y=number_slider_2, Z=number_slider_2)
box_3 = CenterBox(Base=py3_4.all_walker_pts, X=number_slider_3, Y=number_slider_3, Z=number_slider_3)
pline_3 = PolyLine(Vertices=py3_3.all_walker_pts, Closed=False)
pline_4 = PolyLine(Vertices=py3_4.all_walker_pts, Closed=False)
previewlw = CustomPreviewLineweights(Geometry=pline, Shader="black", Thickness=Slider(5, range=0..10), Absolute=False)
previewlw_2 = CustomPreviewLineweights(Geometry=pline_2, Shader="black", Thickness=Slider(5, range=0..10), Absolute=False)
previewlw_3 = CustomPreviewLineweights(Geometry=pline_3, Shader="black", Thickness=Slider(5, range=0..10), Absolute=False)
previewlw_4 = CustomPreviewLineweights(Geometry=pline_4, Shader="black", Thickness=Slider(5, range=0..10), Absolute=False)
preview = CustomPreview(Geometry=box, Material=gradient)
col = Colour(graft(gradient_2))
col_2 = Colour(graft(gradient_3))
preview_2 = CustomPreview(Geometry=box_2, Material=col)
preview_3 = CustomPreview(Geometry=box_3, Material=col_2)
