# Grasshopper definition placepeep.gh (Grasshopper 1.0.8)
# plug-ins: Human

pipeline = GeometryPipeline(
    GroupByLayer=False,
    GroupByType=False,
    IncludeHidden=True,
    IncludeLocked=True,
    LayerFilter="OUTER",
    NameFilter="*",
    SublayerFiltering=True,
    TypeFilter=4)
number_slider = Slider(4, range=0..10)
pipeline_2 = GeometryPipeline(
    GroupByLayer=False,
    GroupByType=False,
    IncludeHidden=True,
    IncludeLocked=True,
    LayerFilter="chair_lines",
    NameFilter="*",
    SublayerFiltering=True,
    TypeFilter=4)
geo = Geometry([<curve referenced from the Rhino model> x2, <brep referenced from the Rhino model>])
crv = Curve([<curve referenced from the Rhino model> x3])
crv_2 = Curve(graft([<curve referenced from the Rhino model> x3]))
defblock = DefineBlock(BlockOrigin=PlaneXY(0, 0, 0), Overwrite=True)
divide = DivideCurve(Curve=pipeline, Count=10, Kinks=False)  # -> Points, Tangents, Parameters
random = Random(Range=Domain(0, 1), Number=number_slider, Seed=Slider(3, range=0..10))
bbox = BoundingBox(Content=geo, Plane=PlaneXY(0, 0, 0), UnionBox=True)  # -> Box, Box_2
block_instance = BlockInstance()
explode = Explode(Curve=pipeline, Recursive=True)  # -> Segments, Vertices
eval = EvaluateCurve(Curve=reparameterize(crv_2), Parameter=random)  # -> Point, Tangent, Angle
divide_2 = DivideCurve(Curve=pipeline_2, Count=10, Kinks=False)  # -> Points, Tangents, Parameters
debox = DeconstructBox(Box=bbox.Box)  # -> Plane, X, Y, Z
pdecon = Deconstruct(Point=divide.Points)  # -> XComponent, YComponent, ZComponent
frame = CurveFrame(Curve=pipeline_2, Parameter=divide_2.Parameters)
pt = Point(eval.Point)
area = Area()  # -> Area, Centroid
flatten = FlattenTree(Tree=pt, Path="{0}")
sort = SortList(Keys=pdecon.YComponent, ValuesA=divide.Points)  # -> Keys, ValuesA
lng = ListLength(List=flatten)
lng_2 = ListLength(List=pt)
data = Data(number_slider)
box = CenterBox(Base=frame, X=debox.X, Y=debox.Y, Z=debox.Z)
series = Series(Start=0, Step=1, Count=lng)
item = ListItem(List=sort.ValuesA, Index=0, Wrap=True)
random_2 = Random(Range=Domain(0, 1), Number=1, Seed=2)
boxmap = BoxMapping(Geometry=geo, Source=bbox.Box, Target=graft(box))  # -> Geometry, Transform
pt_2 = Point(flatten(item))
jitter = Jitter(List=series, Jitter=1, Seed=2)  # -> Values, Indices
cap = CapHoles(Brep=boxmap.Geometry)
item_2 = ListItem(List=flatten, Index=jitter.Values, Wrap=True)
crv_3 = Curve(graft(pipeline))
partition = PartitionList(List=item_2, Size=data)
pt_3 = Point(partition)
preview = CustomPreview(Geometry=cap, Material="pink")
vec2pt = Vector2Pt(PointA=pt_2, PointB=pt_3, Unitize=False)  # -> Vector, Length
panel = Panel(partition)
vdis = VectorDisplay(Anchor=pt_2, Vector=vec2pt.Vector)
scale = Scale(Geometry=flatten(crv_3), Center=pt_2, Factor=Slider(0.005, range=0.001..0.25))  # -> Geometry, Transform
move = Move(Geometry=scale.Geometry, Motion=vec2pt.Vector)  # -> Geometry, Transform
