# Grasshopper definition place-stuff.gh (Grasshopper 1.0.8)
# plug-ins: Human

crv = Curve(<curve referenced from the Rhino model>)
offset = OffsetCurve(Curve=crv, Distance=Slider(-85.7, range=-100..0), Corners=1)
pop2d = Populate2D(Region=offset, Count=Slider(100, range=1..160), Seed=Slider(20, range=1..160))
pipeline = GeometryPipeline(
    GroupByLayer=False,
    GroupByType=False,
    IncludeHidden=True,
    IncludeLocked=True,
    LayerFilter="OUTLINES",
    NameFilter="*",
    SublayerFiltering=True,
    TypeFilter=4)

# ----
# Inputs
pt_target_locs = Point(pop2d)
crv_objs_to_place = Curve(pipeline)

# ----
# Get targ pts list size
pt_target_locs_2 = Point(pt_target_locs)
lng = ListLength(List=pt_target_locs_2)
panel = Panel(lng)
num_of_target_pts = Data(lng)

# ----
# Increase list size to match targ list size
crv_objs_to_place_2 = Curve(crv_objs_to_place)
lng_2 = ListLength(List=crv_objs_to_place_2)
num_of_stuff_to_place = Data(lng_2)
division = Division(A=num_of_target_pts, B=num_of_stuff_to_place)
panel_2 = Panel(num_of_stuff_to_place)
dup = DuplicateData(Data=crv_objs_to_place_2, Number=division, Order=True)
crv_objs_to_place_dupl = Curve(dup)

crv_objs_to_place_3 = Curve(crv_objs_to_place)
area = Area(Geometry=crv_objs_to_place_3)  # -> Area, Centroid

# ----
# Move objects and display xform
pts_geo_to_place_centers = Point(area.Centroid)
pt_target_locs_3 = Point(graft(pt_target_locs_2))
geo_objs_to_place = Geometry(crv_objs_to_place_3)
vec2pt = Vector2Pt(PointA=pts_geo_to_place_centers, PointB=pt_target_locs_3, Unitize=False)  # -> Vector, Length
vdis = VectorDisplay(Anchor=pts_geo_to_place_centers, Vector=vec2pt.Vector)
move = Move(Geometry=geo_objs_to_place, Motion=vec2pt.Vector)  # -> Geometry, Transform
placed_geo = Curve(move.Geometry)

# ----
# Get stuff to place list size
crv_objs_to_place_4 = Curve(crv_objs_to_place)
lng_3 = ListLength(List=crv_objs_to_place_4)
num_of_stuff_to_place_2 = Data(lng_3)
panel_3 = Panel(num_of_stuff_to_place_2)

# ----
# Get targ pts list size
pt_target_locs_4 = Point(pt_target_locs)
lng_4 = ListLength(List=pt_target_locs_4)
num_of_target_pts_2 = Data(lng_4)
panel_4 = Panel(num_of_target_pts_2)

# ----
# Match list size
crv_objs_to_place_dupl_2 = Curve(crv_objs_to_place_dupl)
num_of_target_pts_3 = Data(num_of_target_pts)
lng_5 = ListLength(List=crv_objs_to_place_dupl_2)
num_of_stuff_to_place_dupl = Data(lng_5)
num_stuff_to_place_dupl = Panel(num_of_stuff_to_place_dupl)
num_of_targ_pts = Panel(num_of_target_pts_3)
larger = LargerThan(FirstNumber=num_of_stuff_to_place_dupl, SecondNumber=num_of_target_pts_3)  # -> LargerThan, OrEqualTo
subtraction = Subtraction(A=num_of_stuff_to_place_dupl, B=num_of_target_pts_3)
dispatch = Dispatch(List=crv_objs_to_place_dupl_2, DispatchPattern=larger.LargerThan)  # -> ListA, ListB
dispatch_2 = Dispatch(List=crv_objs_to_place_dupl_2, DispatchPattern=larger.LargerThan)  # -> ListA, ListB
diff_stuff_to_place_list_and_targ_pts_li = Panel(subtraction)  # "diff stuff to place list and targ pts list"
series = Series(Start=0, Step=1, Count=subtraction)
cull_i = CullIndex(List=dispatch_2.ListA, Indices=series, Wrap=True)
geo_objs_to_place_2 = Geometry([cull_i, dispatch.ListB])
clean = CleanTree(RemoveNulls=True, RemoveInvalid=True, RemoveEmpty=True, Tree=geo_objs_to_place_2)
area_2 = Area(Geometry=clean)  # -> Area, Centroid
geo_objs_to_place_3 = Geometry(clean)
pts_geo_to_place_centers_2 = Point(area_2.Centroid)

# ----
# Get rndm ids
num_of_stuff_to_place_3 = Data(num_of_stuff_to_place_2)
num_of_target_pts_4 = Data(num_of_target_pts_2)
random = Random(Range=num_of_stuff_to_place_3, Number=num_of_target_pts_4, Seed=Slider(2, range=0..100))
int = Integer(random)
rndm_ids_for_stuff_to_place = Data(int)

# ----
# Pick one rdm item
rndm_ids_for_stuff_to_place_2 = Data(rndm_ids_for_stuff_to_place)
placed_geo_2 = Curve(placed_geo)
item = ListItem(List=placed_geo_2, Index=graft(rndm_ids_for_stuff_to_place_2), Wrap=True)
placed_geo_3 = Curve(item)

# ----
# Move objects and display xform
pts_geo_to_place_centers_3 = Point(pts_geo_to_place_centers_2)
pt_target_locs_5 = Point(pt_target_locs_2)
geo_objs_to_place_4 = Geometry(geo_objs_to_place_3)
vec2pt_2 = Vector2Pt(PointA=pts_geo_to_place_centers_3, PointB=pt_target_locs_5, Unitize=False)  # -> Vector, Length
vdis_2 = VectorDisplay(Anchor=pts_geo_to_place_centers_3, Vector=vec2pt_2.Vector)
move_2 = Move(Geometry=geo_objs_to_place_4, Motion=vec2pt_2.Vector)  # -> Geometry, Transform
placed_geo_4 = Curve(move_2.Geometry)

# ----
# Visualize
placed_geo_5 = Curve(flatten(placed_geo_3))
lng_6 = ListLength(List=placed_geo_5)
series_2 = Series(Start=0, Step="2", Count=lng_6)
z_height = Data(series_2)
placed_geo_6 = Curve(placed_geo_5)
Z = UnitZ(Factor=z_height)
move_3 = Move(Geometry=placed_geo_6, Motion=Z)  # -> Geometry, Transform
placed_geo_z = Curve(move_3.Geometry)
Z_2 = UnitZ(Factor="1")
move_4 = Move(Geometry=placed_geo_z, Motion=Z_2)  # -> Geometry, Transform
z_height_2 = Data(z_height)
bnd = Bounds(Numbers=z_height_2)
area_3 = Area(Geometry=move_4.Geometry)  # -> Area, Centroid
boundary = BoundarySurfaces(Edges=placed_geo_z)
dedomain = DeconstructDomain(Domain=bnd)  # -> Start, End
tag = TextTag(Location=area_3.Centroid, Text=series_2)
gradient = Gradient(LowerLimit=dedomain.Start, UpperLimit=dedomain.End, Parameter=z_height_2, stops=[0: RGB(255, 255, 255), 1: RGB(0, 0, 0)])
panel_5 = Panel("black")
preview = CustomPreview(Geometry=boundary, Material=ColourSwatch(SwatchColor=RGB(230, 230, 230)))
previewlw = CustomPreviewLineweights(Geometry=move_4.Geometry, Shader=gradient, Thickness=Slider(2, range=1..4), Absolute=False)

# ----
# Visualize
placed_geo_7 = Curve(placed_geo_4)
lng_7 = ListLength(List=placed_geo_7)
series_3 = Series(Start=0, Step="2", Count=lng_7)
z_height_3 = Data(series_3)
placed_geo_8 = Curve(placed_geo_7)
Z_3 = UnitZ(Factor=z_height_3)
move_5 = Move(Geometry=placed_geo_8, Motion=Z_3)  # -> Geometry, Transform
Z_4 = UnitZ(Factor="20")
placed_geo_z_2 = Curve(move_5.Geometry)
move_6 = Move(Geometry=placed_geo_z_2, Motion=Z_4)  # -> Geometry, Transform
z_height_4 = Data(z_height_3)
boundary_2 = BoundarySurfaces(Edges=placed_geo_z_2)
bnd_2 = Bounds(Numbers=z_height_4)
area_4 = Area(Geometry=move_6.Geometry)  # -> Area, Centroid
dedomain_2 = DeconstructDomain(Domain=bnd_2)  # -> Start, End
tag_2 = TextTag(Location=area_4.Centroid, Text=series_3)
gradient_2 = Gradient(
    LowerLimit=dedomain_2.Start,
    UpperLimit=dedomain_2.End,
    Parameter=z_height_4,
    stops=[0: RGB(255, 255, 255), 1: RGB(0, 0, 0)])
preview_2 = CustomPreview(Geometry=boundary_2, Material=ColourSwatch(SwatchColor=RGB(230, 230, 230)))
previewlw_2 = CustomPreviewLineweights(Geometry=move_6.Geometry, Shader=gradient_2, Thickness=Slider(2, range=1..4), Absolute=False)
